# Grasshopper definition bem_simulate_2.gh (Grasshopper 1.0.7)
# plug-ins: Heteroptera, Human, Ironbug.LBHB_Legacy

model_deg = Slider(5, range=0..39)
python = GhPythonScript(idx=model_deg, sleep=Toggle(True), data_num="10")  # -> model_num, degree, slider_num; inputs data_num: Int32
# ---------- python: Python ----------
import rhinoscriptsyntax as rs

DEG_NUM = 4

idx = int(_idx + 1)

degree = idx % DEG_NUM
model_num = int(_idx / DEG_NUM)

print(model_num, degree)

slider_num = str(_data_num_ * DEG_NUM) + ' - 1'

if _sleep_:
    rs.Sleep(1000)
# ---------- end python ----------
panel = Panel(python.slider_num)
path = FilePath("C:\Users\Administrator\master\git\deeprad\data\models\")
panel_2 = Panel(python.model_num)
python_2 = GhPythonScript(model_num=panel_2, models_dir=path, run=Toggle(True))  # -> polys, model_id, sim_dir; inputs model_num: Int32
# ---------- python_2: Python ----------
import os 
import json 
#import rhinoscriptsyntax as rs
import Rhino as rc

DEEPRAD_DATA_DIR = _models_dir

def extract_floorplan_ids(data_num):
    """Safely extract root model directories for polygon extraction."""

    # Load all model directories
    floorplan_id_arr = os.listdir(DEEPRAD_DATA_DIR)
    n_ids = len(floorplan_id_arr)
    
    if data_num > n_ids:
        print('Note: data_num {} is too high. Resetting to n_ids {}.'.format(
            data_num, n_ids))
        data_num = n_ids
    
    return data_num, floorplan_id_arr

def to_poly_rh(poly_xy):
    pts = [(round(x, 5), round(y, 5), 0) for x,y in zip(*poly_xy)]
    pts = [rc.Geometry.Point3d(*pt) for pt in pts]
    pts = pts + [pts[0]]
    return rc.Geometry.Polyline(pts)

def load_json(json_fpath):
    with open(json_fpath, 'r') as fp:
        val_dict = json.load(fp)
    return val_dict

#def get_model(_model_num):
#    _model_num = int(_model_num)
#    _model_num, model_ids = extract_floorplan_ids(_model_num)
#    model_id = model_ids[_model_num]
#    return model_id 
    
if run:
    
    null_fpath = os.path.join(DEEPRAD_DATA_DIR, '_null.txt')
    with open(null_fpath, 'r') as fp:
        null_lst = fp.readlines()
    model_id_lst = [n.replace('\n', '') for n in null_lst]
    model_id = model_id_lst[_model_num]
    
    # Polygon json
    model_id_dir = os.path.join(
        DEEPRAD_DATA_DIR, model_id, 'data')
    polygon_json_fpath = os.path.join(model_id_dir, 'polygon.json')

    polygons = load_json(polygon_json_fpath)
    polygons = polygons['polygons']
    
    polys = [to_poly_rh(polygon) for polygon in polygons]
    sim_dir = model_id_dir + '_sim'
# ---------- end python_2 ----------
toggle = BooleanToggle(True)  # disabled
panel_3 = Panel("1.1.0")  # disabled
versioner = LBVersioner(update=toggle, version=panel_3)  # -> Vviiiiiz; disabled; plug-in component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

# ----
# Center geoms
boundary = BoundarySurfaces(Edges=python_2.polys)
bbox = BoundingBox(Content=boundary, Plane=PlaneXY(0, 0, 0), UnionBox=True)  # -> Box, Box_2
area = Area(Geometry=bbox.Box)  # -> Area, Centroid

neg = Negative(Value=area.Centroid)
panel_4 = Panel(versioner)  # disabled
move = Move(Geometry=python_2.polys, Motion=neg)  # -> Geometry, Transform
boundary_2 = BoundarySurfaces(Edges=graft(move.Geometry))  # -> flatten(Surfaces)
panel_5 = Panel("https://www.energyplus.net/weather-download/north_and_central_america_wmo_region_4/USA/MA/USA_MA_Boston-Logan.Intl.AP.725090_TMY3/all")
room2d = DFRoom2D(geo=flatten(boundary_2), flr_to_ceiling="2.5", conditioned=Toggle(True))  # -> report, room2d; plug-in component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
panel_6 = Panel(python.degree)
toggle_2 = BooleanToggle(True)
panel_7 = Panel(python_2.model_id)
panel_8 = Panel(python_2.sim_dir)
simpleratiopar = DFSimpleWindowRatioParameters(ratio="0.3")  # -> win_par; plug-in component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
python_3 = GhPythonScript(deg=panel_6)  # -> orient, point
# ---------- python_3: Python ----------
import math 
import Rhino.Geometry as rhgeom

D = {0: 'north', 90: 'east', 180: 'south', 270: 'west'} 

a = deg * 90.0
rad = a / 180.0 * math.pi

point = rhgeom.Point3d(math.sin(rad) * 100, math.cos(rad) * 100, 0)
orient = D[int(a)]
# ---------- end python_3 ----------
downloadepw = LBDownloadWeather(weather_URL=panel_5)  # -> epw_file, stat_file, ddy_file; plug-in component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
toggle_3 = BooleanToggle(True)
introom2d = DFIntersectRoom2Ds(room2ds=flatten(room2d.room2d), run=toggle_2)  # -> int_room2ds; plug-in component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
solveadj2d = DFSolveAdjacency(room2ds=flatten(introom2d), run=toggle_2)  # -> report, adj_room2ds; plug-in component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
applyfacadepar = DFApplyFacadeParameters(df_obj=flatten(solveadj2d.adj_room2ds), win_par=simpleratiopar)  # -> report, df_obj; plug-in component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
simoutput = HBSimulationOutput(zone_energy_use=toggle_3, gains_and_losses=toggle_3, surface_energy_flow=toggle_3)  # -> report, sim_output; plug-in component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
camera = CameraCrane(Location=python_3.point, Target="0,0,0", Perspective="0", Refresh=True)  # -> Camera, Target, Lens, Up, HorizontalViewAngle, VerticalViewAngle, ScreenRatio, Frame
story = DFStory(room2ds=flatten(applyfacadepar.df_obj))  # -> report, story; plug-in component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
buildingstories = DFBuildingFromStories(stories=story.story)  # -> report, building; plug-in component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
model = DFModel(buildings=flatten(buildingstories.building), name=panel_7)  # -> report, model; plug-in component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
toggle_4 = BooleanToggle(True)
data = Data(python_2.model_id)
data_2 = Data(path)
analysisperiod = LBAnalysisPeriod(start_month="1", start_day=1, start_hour=0, end_month="1")  # -> period, hoys, dates; plug-in component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
python_4 = GhPythonScript(model_dir=data_2, model_id=data, view=python_3.orient, run=toggle_4)  # -> img_dir, img_fpath
# ---------- python_4: Python ----------
import os 
    
if run:
    img_dir = \
        os.path.join(_model_dir, '..', 'train_test', _model_id)
    img_dir = os.path.abspath(img_dir)
    
    img_fpath = \
        os.path.join(img_dir, 'label_{}.jpg'.format(_view))
    img_fpath = os.path.abspath(img_fpath)
    
    #print _model_id
    #print img_fpath
# ---------- end python_4 ----------
tohoneybee = DFModelToHoneybee(model=model.model, run=Toggle(True))  # -> report, hb_models; plug-in component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
panel_9 = Panel(python_4.img_fpath)
imageviewer = Ladybug_ImageViewer(ImagePath_=python_4.img_fpath, _scale_=1, DisableClickable=False, SaveImgWithCoords=False, scale=1)  # -> ImagePath, Values, GIF
saveview = SaveViewportToFile(Run=toggle_4, Render=False, FilePath=python_4.img_fpath, ScaleFactor=1)
panel_10 = Panel("Surface Outside Face Solar Radiation Heat Gain Energy")
data_3 = Data(panel_10)
customoutput = HBCustomSimulationOutput(base_sim_output=simoutput.sim_output, output_names=data_3)  # -> report, sim_output; plug-in component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
panel_11 = Panel(data_3)
simpar = HBSimulationParameter(output=customoutput.sim_output, run_period=analysisperiod.period, timestep=6)  # -> sim_par; plug-in component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
importepw = LBImportEPW(epw_file=downloadepw.epw_file)  # -> location, dry_bulb_temperature, dew_point_temperature, relative_humidity, wind_speed, wind_direction, direct_normal_rad, diffuse_horizontal_rad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; plug-in component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
vizbytype = HBVisualizeByType(hb_objs=tohoneybee.hb_models)  # -> walls, interior_walls, roofs, ceilings, exterior_floors, interior_floors, air_walls, apertures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; plug-in component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
modeltoosm = HBModelToOSM(model=tohoneybee.hb_models, epw_file=downloadepw.epw_file, sim_par=simpar, folder=panel_8, write=Toggle(False), run="3")  # -> report, jsons, osw, osm, idf, sql, zsz, rdd, html; plug-in component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
vizbybc = HBVizualizeByBC(hb_objs=tohoneybee.hb_models)  # -> outdoors, surface, ground, adiabatic, other, wire_frame; plug-in component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
vizall = HBVizualizeAll(hb_objs=flatten(tohoneybee.hb_models))  # -> geo; plug-in component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
panel_12 = Panel("Solar Surface")  # disabled
customresult = HBReadCustomResult(sql=modeltoosm.sql, output_names=panel_10)  # -> results; plug-in component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
readrdd = HBReadResultDictionary(rdd=modeltoosm.rdd, keywords=panel_12)  # -> outputs; disabled; plug-in component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
facen = FaceNormals(Mesh=vizbytype.walls)  # -> Centers, Normals
legendpar = LBLegendParameters(min="0", max="1500")  # -> leg_par; plug-in component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
facen_2 = FaceNormals(Mesh=vizbytype.apertures)  # -> Centers, Normals
data_4 = Data(tohoneybee.hb_models)
panel_13 = Panel(modeltoosm.sql)
python_5 = GhPythonScript(x=facen.Centers)  # -> a; inputs x: list
# ---------- python_5: Python ----------
import scriptcontext as sc 
import rhinoscriptsyntax as rs



x = [rs.coerce3dpoint(xx) for xx in x]
a = [xx[0] for xx in x]

print a
# ---------- end python_5 ----------
multiplication = Multiplication(A=facen_2.Normals, B="0.006")
skymatrix = LBCumulativeSkyMatrix(location=importepw.location, direct_rad=importepw.direct_normal_rad, diffuse_rad=importepw.diffuse_horizontal_rad)  # -> report, sky_mtx; plug-in component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
panel_14 = Panel(readrdd)  # disabled
colorfaces = HBColorFaces(data=flatten(customresult), hb_objs=flatten(data_4))  # -> report, mesh, wire_frame, legend, title, faces, colors, values; plug-in component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
move_2 = Move(Geometry=vizbytype.apertures, Motion=multiplication)  # -> Geometry, Transform
heatmap = LBSpatialHeatmap(values=python_5, mesh=vizbytype.walls)  # -> mesh, legend, title, colors, legend_par; plug-in component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
medges = MeshEdges(Mesh=move_2.Geometry)  # -> NakedEdges, InteriorEdges, NonManifoldEdges
incidentradiation = LBIncidentRadiation(
    sky_mtx=skymatrix.sky_mtx,
    geometry=flatten(vizall),
    grid_size="1",
    offset_dist="0.005",
    legend_par=legendpar,
    run=Toggle(True))  # -> report, points, results, total, mesh, legend, title, int_mtx; plug-in component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
preview = CustomPreview(
    Geometry=[vizbytype.wire_frame, medges.NakedEdges, medges.InteriorEdges, medges.NonManifoldEdges],
    Material=ColourSwatch(SwatchColor=RGB(0, 0, 0)))
python_6 = GhPythonScript(x=incidentradiation.results)  # -> min, max, t; inputs x: list
# ---------- python_6: Python ----------
_x = sorted(x)
min_, max_ = _x[0], _x[-1]
t = x
# ---------- end python_6 ----------
mesh = Mesh(incidentradiation.mesh)
panel_15 = Panel([python_6.min, python_6.max])
toggle_5 = BooleanToggle(True)  # disabled
path_2 = FilePath("C:\Users\Administrator\master\git\deeprad\data\models\")  # disabled
python_7 = GhPythonScript(model_id=panel_7, models_dir=path_2, faces=colorfaces.faces, values=colorfaces.values, run=toggle_5)  # -> result; inputs faces: list, values: list; disabled
# ---------- python_7: Python ----------
import os 
import json 

def write_json(val_dict, dest_fpath):
    """Writes hdict to json."""
    with open(dest_fpath, 'w') as fp:
        json.dump(val_dict, fp, indent=4)
        
# Dump face/val as json
DEEPRAD_DATA_DIR = _models_dir 

if run:
    sim_id_dir = \
        os.path.join(DEEPRAD_DATA_DIR, _model_id, 'data_sim')
    label_json_fpath = \
        os.path.join(sim_id_dir, 'label_sim.json')
    
    val_dict = {
        'face_ids': [f.identifier for f in _faces],
        'values': _values
    }
    
    write_json(val_dict, label_json_fpath)
    result = label_json_fpath
# ---------- end python_7 ----------
panel_16 = Panel(python_7)  # disabled
